# Grasshopper definition Grasshopper_script.gh (Grasshopper 1.0.7)
# Copyright: Job de Vogel

# ---- group: RUN_ROBODK!
# 1.
# README 1: The Python script above is developed to make the interaction between Grasshopper and RoboDK easier. The first input will run RoboDK. By clicking on RunProg, you can run a specific program in RoboDK, from Grasshopper.
# 
# See manual for extensive explanation
program = ValueList({"Generate program": "Generate_csv_program", "Import geometry": "Import_Rhino_geometry"}, selected="Import geometry")
execute_robodk_program = GhPythonScript(RUN_RoboDK=Button(), RunProg=Button(), Program_Name=program)  # -> msg
# ---------- execute_robodk_program: Python ----------
"""Provides a scripting component.
    Inputs:
        RUN_RoboDK: If button turned True, RoboDK wil start running
        RunProg: If button turned True, RoboDK will start your script
        Program_Name: The name of your program to run
        Overwrite_RoboDK_path: Overwrite the path of the default RoboDK installation directory (C:\RoboDK\BIN\RoboDK.exe). Please use backslash \ and if necessary write BIN in capital characters.
        Overwrite_file_path: Overwrite the path of the default file directory (gh file save location folder)
    Output:
        msg: Message"""

__author__ = "Job de Vogel"
__version__ = "2021.09.20"

import subprocess
import os
from os import path

#Expected file locations of RoboDK and your robot file
RDK_DIR = 'C:\RoboDK\BIN\RoboDK.exe'
FILE_DIR = os.path.dirname(ghdoc.Path) + "\\" + "UR5_station_default.rdk"

#If overwrite for paths, set the variables to overwrite string
if Overwrite_RoboDK_path:
    RDK_DIR = r"" + Overwrite_RoboDK_path

if Overwrite_file_path:
    FILE_DIR = r"" + Overwrite_file_path

if not Program_Name:
    Program_Name = ""

#MAIN, run the script
args = []
running = False

#Run RoboDK with your selected file
if RUN_RoboDK:
    args = [RDK_DIR, FILE_DIR]

    #Check if expected RDK installation directory exist
    if not path.exists(RDK_DIR):
        msg = "Your RDK file directory does not exist, please overwrite using the overwrite input."
        args =[]
    
    #Check if expected file directory exist
    if not path.exists(FILE_DIR):
        msg = "Your RoboDK save file .rdk does not exist, please overwrite unsing the overwrite input."
        args = []

#Run your program in an opened RoboDK instance
if RunProg:
    args = [RDK_DIR, "-RunProg=" + Program_Name]

    #Pass if no program specified
    if not Program_Name:
        msg = "Please specify a program name to run as input"
        args = []

"""
HERE YOU CAN ADD EXTRA FUNCTIONS TO THIS SCRIPT

1. RUN: TOOLS > RUN SCRIPT > SHOWCOMMANDS 
IN ROBODK TO SEE WHICH COMMANDS ARE AVAILABLE

2. ADD AN EXTRA INPUT PARAMETER TO THE GH COMPONENT

3. CREATE AN EXTRA IF-ELSE STATEMENT TO CHECK IF INPUT HAS DATA

4. SET ARGS TO (FOR EXAMPLE):
args = [RDK_DIR, -ColorBgBottum = #RRGGBB]
"""

#If script should run both RoboDK instance and Program, skip
if RUN_RoboDK == RunProg == True:
    msg = "You can only exectute one command at a time"
    args = []

#Run all the arguments
if args:
    subprocess.Popen(args)
# ---------- end execute_robodk_program ----------

# ---- group: Brick_drop_origin
brep = Brep(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)

# ---- group: Brick_pick_origin
brep_2 = Brep(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)

# ----
evaluate_box = EvaluateBox(Box=brep_2, UParameter=0.5, VParameter=0.5, WParameter=0.5)  # -> Plane, Point, Include
y = Slider(4, range=0..5)
step_x = Slider(150, range=0..500)
x = Slider(4, range=0..5)
step_y = Slider(100, range=0..500)
step_z = Slider(30, range=0..200)
# README 2: This part of the script generates a pyramid stack of geometries, in this case bricks. As you can see, the script consists of two different inputs. The first input is where the origin brick has to be picked, the second where the bricks has to be dropped.
# 
# The difference between the top and the bottom part, is that the bricks are picked in reversed order (the robot starts on top of the pyramid, and takes brick layer by layer)
# 
# For more info check user guide
# 2.
cluster = Cluster(geometry=brep_2, plane=evaluate_box.Plane, X=x, Y=y, step_x=step_x, step_y=step_y, step_z=step_z)  # -> flatten(geometry_2), flatten(planes)
approach_distance = Slider(100, range=0..200)
plane_conversion = Plane_conversion(plane=cluster.planes)
reverse_list = ReverseList(List=cluster.geometry_2)
Z = UnitZ(Factor=approach_distance)
move = Move(Geometry=plane_conversion, Motion=Z)  # -> Geometry, Transform
reverse_list_2 = ReverseList(List=plane_conversion)
reverse_list_3 = ReverseList(List=move.Geometry)

evaluate_box_2 = EvaluateBox(Box=brep, UParameter=0.5, VParameter=0.5, WParameter=0.5)  # -> Plane, Point, Include
x_2 = Slider(4, range=0..5)
y_2 = Slider(4, range=0..5)
step_x_2 = Slider(150, range=0..500)
step_y_2 = Slider(100, range=0..500)
step_z_2 = Slider(30, range=0..200)
cluster_2 = Cluster(geometry=brep, plane=evaluate_box_2.Plane, X=x_2, Y=y_2, step_x=step_x_2, step_y=step_y_2, step_z=step_z_2)  # -> flatten(geometry_2), flatten(planes)
approach_distance_2 = Slider(100, range=0..200)
plane_conversion_2 = Plane_conversion(plane=cluster_2.planes)
geometry = Geometry(cluster_2.geometry_2)
Z_2 = UnitZ(Factor=approach_distance_2)
move_2 = Move(Geometry=plane_conversion_2, Motion=Z_2)  # -> Geometry, Transform

approach_drop_prepare_move_back = Plane(move_2.Geometry)
approach_pick_prepare_move = Plane(reverse_list_3)
geometry_2 = Geometry(reverse_list)
pick = Plane(reverse_list_2)
drop = Plane(plane_conversion_2)

# ----
# 0 Approach Pick
# 1 Pick
# 2 Prepare move
# 3 Approach Drop
# 4 Drop
# 5 Prepare move back
panel = Panel("""0
1
2
3
4
5""")
weave = Weave(
    Pattern=panel,
    Stream0=approach_pick_prepare_move,
    Stream1=pick,
    Stream2=approach_pick_prepare_move,
    Stream3=approach_drop_prepare_move_back,
    Stream4=drop,
    Stream5=approach_drop_prepare_move_back,
    NullGaps=False)

# ---- group: Extract order of instructions
list_length = ListLength(List=weave)
repeat_data = RepeatData(Data=panel, Length=list_length)

# ---- group: Set speed for each point
panel_2 = Panel("""2
5""")
data = Data(repeat_data)
move_speed_mm_s = Slider(300, range=1..300)
list_length_2 = ListLength(List=data)
app_speed_mm_s = Slider(100, range=0..300)
ghpython_script = GhPythonScript(First_Number=data, Equality_Numbers=panel_2)  # -> Boolean; inputs First_Number: list, Equality_Numbers: list
# ---------- ghpython_script: Python ----------
"""Check if First_Number is equal to one of the Equality_Numbers
    Inputs:
        First_Number: Number to check
        Equality_Numbers: Number that First_Number should be equal to
    Output:
        Boolean: True if equal to one of the Equality_Numbers"""

__author__ = "Job de Vogel"
__version__ = "2021.09.22"

Boolean = []

#For each First_Number
for i in First_Number:
    Bool = False

    #For each Equality_Number
    for j in Equality_Numbers:

        #Bool True if First_Number equal to Equality_Number
        if i == j:
            Bool = True
    Boolean.append(Bool)
# ---------- end ghpython_script ----------
repeat_data_2 = RepeatData(Data=app_speed_mm_s, Length=list_length_2)
repeat_data_3 = RepeatData(Data=move_speed_mm_s, Length=list_length_2)
weave_2 = Weave(Pattern=ghpython_script, Stream0=repeat_data_2, Stream1=repeat_data_3, NullGaps=False)
subtraction = Subtraction(A=list_length_2, B=1)
sub_list = SubList(List=weave_2, Domain=subtraction, Wrap=True)  # -> List, Index
ghpython_script_2 = GhPythonScript(Data=sub_list.List)  # -> Nulled_Data; inputs Data: list
# ---------- ghpython_script_2: Python ----------
"""Check if repetition of numbers occurs and replace repetition for EMPTY valye
    Inputs:
        Data: Data to check if repetition can be deleted
    Output:
        Nulled_Data: Data with EMPTY inserted"""

__author__ = "Job de Vogel"
__version__ = "2021.09.22"

import rhinoscriptsyntax as rs

Data = Data[::-1]

for i, num in enumerate(Data):
    try:
        if num == Data[i+1]:
            Data[i] = ""
    except IndexError:
        pass

Nulled_Data = Data[::-1]
# ---------- end ghpython_script_2 ----------
data_2 = Data(ghpython_script_2)

# ---- group: Set tool attach/detach for each point
panel_3 = Panel("""0
4
5""")
data_3 = Data(repeat_data)
list_length_3 = ListLength(List=data_3)
attach = Panel("Attach")
detach = Panel("Detach")
ghpython_script_3 = GhPythonScript(First_Number=data_3, Equality_Numbers=panel_3)  # -> Boolean; inputs First_Number: list, Equality_Numbers: list; same code as ghpython_script
repeat_data_4 = RepeatData(Data=attach, Length=list_length_3)
repeat_data_5 = RepeatData(Data=detach, Length=list_length_3)
weave_3 = Weave(Pattern=ghpython_script_3, Stream0=repeat_data_4, Stream1=repeat_data_5, NullGaps=False)
subtraction_2 = Subtraction(A=list_length_3, B=1)
sub_list_2 = SubList(List=weave_3, Domain=subtraction_2, Wrap=True)  # -> List, Index
ghpython_script_4 = GhPythonScript(Data=sub_list_2.List)  # -> Nulled_Data; inputs Data: list; same code as ghpython_script_2
# 8.
# README 8: To be specific, column 9 reads where RoboDK should add a subprogram. You can also add other subprograms in this list, for example: detach + pause 1000ms. This means RoboDK adds a subprogram that detaches an object and then pauses 1000ms.
data_4 = Data(ghpython_script_4)

# ----
joint = Panel("joint")
linear = Panel("linear")

# ---- group: Movement type
panel_4 = Panel("""1
2
4
5""")
data_5 = Data(repeat_data)
list_length_4 = ListLength(List=data_5)
ghpython_script_5 = GhPythonScript(First_Number=data_5, Equality_Numbers=panel_4)  # -> Boolean; inputs First_Number: list, Equality_Numbers: list; same code as ghpython_script
repeat_data_6 = RepeatData(Data=joint, Length=list_length_4)
repeat_data_7 = RepeatData(Data=linear, Length=list_length_4)
weave_4 = Weave(Pattern=ghpython_script_5, Stream0=repeat_data_6, Stream1=repeat_data_7, NullGaps=False)
subtraction_3 = Subtraction(A=list_length_4, B=1)
sub_list_3 = SubList(List=weave_4, Domain=subtraction_3, Wrap=True)  # -> List, Index
data_6 = Data(sub_list_3.List)

# ---- group: Extract angle in relation to robot
xy = XYPlane(Origin=Point(0, 0, 0))
orient = Orient(Source=xy, Target=weave)  # -> Geometry, Transform
c_script = CSharpScript(x=orient.Transform)  # -> out, A, B, C; inputs x: Transform
# ---------- c_script: C# ----------
    A = Math.Atan2(x.M21, x.M22);
    B = -Math.Atan2(x.M20, Math.Sqrt(x.M21 * x.M21 + x.M22 * x.M22));
    C = Math.Atan2(x.M10, x.M00);
# ---------- end c_script ----------
deg = Degrees(Radians=c_script.A)
deg_2 = Degrees(Radians=c_script.B)
deg_3 = Degrees(Radians=c_script.C)

# ---- group: Convert geometry meshes to CSV data
geometry_3 = Geometry(geometry_2)
mesh_brep = MeshBrep(
    Brep=geometry_3,
    Settings={GridMaxCount=0, GridMinCount=16, JaggedSeams=False, MaxEdgeLength=0, MinEdgeLength=0.0001, MinTolerance=0, Refine=True, RefineAngle=0, RelativeTolerance=0.65, SimplePlanes=True, Tolerance=0})
text = Text(geometry_3)
list_length_5 = ListLength(List=text)
triangulate = Triangulate(Mesh=mesh_brep)  # -> Mesh, Count
series = Series(Start=0, Step=1, Count=list_length_5)
# README 3: It is not easy to export loads of geometries from Rhino to import in RoboDK. This Python script converts the geometry to a mesh and adds the vertex data to a CSV file. By using the Import_Rhino_Geometry.py script in RoboDK, you can read this data again and recreate the meshes in RoboDK.
# 
# See manual for extensive explanation
# 3.
deconstruct_mesh = DeconstructMesh(Mesh=triangulate.Mesh)  # -> simplify(Vertices), simplify(Faces), Colours, Normals
concatenate = Concatenate(FragmentA=text, FragmentB="_", FragmentA_2=series)
deconstruct_face = DeconstructFace(Face=deconstruct_mesh.Faces)  # -> CornerA, CornerB, CornerC, CornerD
deconstruct = Deconstruct(Point=deconstruct_mesh.Vertices)  # -> XComponent, YComponent, ZComponent
ghpython_script_6 = GhPythonScript(
    Vertices_x=deconstruct.XComponent,
    Vertices_y=deconstruct.YComponent,
    Vertices_z=deconstruct.ZComponent,
    Triangle_corner_1=deconstruct_face.CornerA,
    Triangle_corner_2=deconstruct_face.CornerB,
    Triangle_corner_3=deconstruct_face.CornerC,
    Names=concatenate)  # -> msg; inputs Vertices_x: tree, Vertices_y: tree, Vertices_z: tree, Triangle_corner_1: tree, Triangle_corner_2: tree, Triangle_corner_3: tree, Names: list
# ---------- ghpython_script_6: Python ----------
"""Provides a scripting component.
    Inputs:
        Vertices_x: X coordinate of vertices
        Vertices_y: Y coordinate of vertices
        Vertices_z: Z coordinate of vertices
        Triangle_corner_1: First triangle corners
        Triangle_corner_2: Second triangle corners
        Triangle_corner_3: Third triangle corners
        Names: Names of the geometry
    Output:
        msg: Output message"""
        
__author__ = "Job de Vogel"
__version__ = "2021.10.27"

from ghpythonlib import treehelpers as th
from Grasshopper.Kernel import GH_RuntimeMessageLevel as RML
import os
import csv
import itertools

# Specify the path to write file to
if not overwrite_DIR:
    DIR = os.path.dirname(ghdoc.Path) + "\geometry_csv_data.csv"
else:
    DIR = r"" + overwrite_DIR + "\geometry_csv_data.csv"

# Convert inputs from tree to Python list
vert_x = th.tree_to_list(Vertices_x, False)
vert_y = th.tree_to_list(Vertices_y, False)
vert_z = th.tree_to_list(Vertices_z, False)
Tc_1 = th.tree_to_list(Triangle_corner_1, False)
Tc_2 = th.tree_to_list(Triangle_corner_2, False)
Tc_3 = th.tree_to_list(Triangle_corner_3, False)

try:
    #Write the data to your csv_file
    with open(DIR, 'wb') as f:
        writer = csv.writer(f)

        # For every triangle
        for i, name in enumerate(Names):

            # Write all the vertex coordinates
            for vx, vy, vz in zip(vert_x[i], vert_y[i], vert_z[i]):
                data = ["v", vx, vy, vz]
                writer.writerow(data)
            
            # Write all order of vertices
            for T1, T2, T3 in zip(Tc_1[i], Tc_2[i], Tc_3[i]):
                data = ["o", T1, T2, T3]
                writer.writerow(data)

            # Add the name to the CSV
            data = ["n", name]
            writer.writerow(data)

            # Give output message
            msg = "Geometry CSV succesfully written to {}".format(DIR)
            ghenv.Component.AddRuntimeMessage(RML.Remark, msg)
except IOError:
    msg = "CSV is probably open in other window."
    ghenv.Component.AddRuntimeMessage(RML.Warning, "CSV is probably open in other window.")

if len(Names) < len(vert_x):
    msg = "Some meshes do not have a name, they will be skipped. Add a name in the Names input."
# ---------- end ghpython_script_6 ----------

# ---- group: Extract XYZ coordinates
deplane = DeconstructPlane(Plane=weave)  # -> Origin, XAxis, YAxis, ZAxis
pdecon = Deconstruct(Point=deplane.Origin)  # -> XComponent, YComponent, ZComponent

# ----
column_1_x = Panel(pdecon.XComponent)
column_4_w = Panel(deg)
column_2_y = Panel(pdecon.YComponent)
column_3_z = Panel(pdecon.ZComponent)
column_5_p = Panel(deg_2)
column_6_r = Panel(deg_3)
# 5.
# README 5: For each movement, we need to be able to set the speed of the Robot. This script checks the type of movement. For example, approaching the PICK should be slow, MOVEMENT of the brick should go quickly.
column_7_speed = Panel(data_2)
# 6.
# README 6: For each movement, we should know if the robot has to execute a linear or joint movement. The difference between these movements will be explained during the lectures.
column_8_movement_type = Panel(data_6)
# 7.
# README 7: For each point the Robot arm moves to, we need to know if the gripper should attach or detach an object (open or close). Therefore we create a subprogram in RoboDK which will do that for us. The instructions of the subprogram have to be assigned manually in RoboDK.
column_9_subprogram = Panel(data_4)

# ---- group: Write data to csv
# 4.
entwine = Entwine(
    Branch00=column_1_x,
    Branch01=column_2_y,
    Branch02=column_3_z,
    Branch03=column_4_w,
    Branch04=column_5_p,
    Branch05=column_6_r,
    Branch06=column_7_speed,
    Branch07=column_8_movement_type,
    Branch08=column_9_subprogram,
    FlattenInputs=True)  # -> simplify(Result)
# README 4: All the plane data is entwined here and converted to a CSV file. Open your explorer and search for the CSV file in the msg directory. This data will be used in RoboDK to create the program. You can add your own data by clicking on the + icon in the inputs of the entwine node.
# 
# See manual for extensive explanation
write_point_data_to_csv = GhPythonScript(data=entwine)  # -> msg; inputs data: tree
# ---------- write_point_data_to_csv: Python ----------
"""Write your data to csv, make sure you have not opened your the csv in a seperate window.
    Inputs:
        data: Your csv data to save (by row)
        overwrite_DIR: Overwrite the default directory
    Output:
        msg: Script message"""

__author__ = "Job de Vogel"
__version__ = "2021.09.17"

from ghpythonlib import treehelpers as th
from Grasshopper.Kernel import GH_RuntimeMessageLevel as RML
import os
import csv
import itertools

if not overwrite_DIR:
    DIR = os.path.dirname(ghdoc.Path) + "\csv_data.csv"
else:
    DIR = r"" + overwrite_DIR + "\csv_data.csv"

#Convert GH tree to Python list structure
data = th.tree_to_list(data, False)

#Variable to include final csv_data
csv_data = []

#Flip Matrix (csv.write needs to be by row, not by column)
def SwapRowsColumns(data):
    #Triangular swap rows and columns
    swapped = itertools.izip_longest(*data)

    #Extract zipped data
    extracted = [[item for item in row if item is not None] for row in swapped]
    return extracted

#MAIN
#Check data types and add to final csv_data
data = SwapRowsColumns(data)

for row in data:
    row_data = []
    
    for item in row:
        try:
            row_data.append(item)
        except:
            ghenv.Component.AddRuntimeMessage(RML.Warning, "Not all data inputs have the same length.")
    csv_data.append(row_data)

try:
    #Write the data to your csv_file
    with open(DIR, 'wb') as f:
        writer = csv.writer(f)
        
        #Write csv in for-loop to avoid IronPython nested list types
        for row in csv_data:
            data = row
            writer.writerow(data)
    
    msg = "CSV succesfully written to {}".format(DIR)
    ghenv.Component.AddRuntimeMessage(RML.Remark, msg)
except IOError:
    msg = "CSV is probably open in other window."
    ghenv.Component.AddRuntimeMessage(RML.Warning, "CSV is probably open in other window.")
# ---------- end write_point_data_to_csv ----------

# ----
panel_5 = Panel(ghpython_script_6)
panel_6 = Panel(write_point_data_to_csv)

# ==== cluster Cluster
step_z = ClusterInput()
step_y = ClusterInput()
step_x = ClusterInput()
# README: This script generates a pyramid like stack of geometries. It can probably improved, but it works...
X = ClusterInput()
Y = ClusterInput()
sort_list = SortList(Keys=[X, Y])  # -> Keys, ValuesValuesA
series = Series(Start=1, Step=1, Count=Y)
series_2 = Series(Start=1, Step=1, Count=X)
list_item = ListItem(List=sort_list.Keys, Index=-1, Wrap=True)
reverse_list = ReverseList(List=series)
reverse_list_2 = ReverseList(List=series_2)
series_3 = Series(Start=0, Step=step_y, Count=reverse_list)
series_4 = Series(Start=0, Step=step_x, Count=reverse_list_2)
insert_items = InsertItems(List=series_2, Item=0, Indices=0, Wrap=True)
division = Division(A=step_x, B=2)
insert_items_2 = InsertItems(List=series, Item=0, Indices=0, Wrap=True)
series_5 = Series(Start=0, Step=step_z, Count=list_item)  # -> graft(Series)
division_2 = Division(A=step_y, B=2)
cull_index = CullIndex(List=insert_items, Indices=-1, Wrap=True)
cross_reference = CrossReference(ListListA=series_4, ListListB=series_3, CrossMode=1)  # -> simplify(ListListA), simplify(ListListB)
cull_index_2 = CullIndex(List=insert_items_2, Indices=-1, Wrap=True)
multiplication = Multiplication(A=division, B=cull_index)  # -> graft(Result)
multiplication_2 = Multiplication(A=division_2, B=cull_index_2)  # -> graft(Result)
addition = Addition(A=multiplication, B=cross_reference.ListListA)
addition_2 = Addition(A=cross_reference.ListListB, B=multiplication_2)
construct_point = ConstructPoint(XCoordinate=addition, YCoordinate=addition_2, ZCoordinate=series_5)  # -> simplify(Point)
orient = Orient(Geometry=construct_point, Source=PlaneXY(0, 0, 0), Target=PlaneXY(0, 0, 0))  # -> Geometry, Transform
geometry = ClusterInput()
plane = ClusterInput()
xy_plane = XYPlane(Origin=orient.Geometry)
orient_2 = Orient(Geometry=geometry, Source=PlaneXY(0, 0, 0), Target=xy_plane)  # -> Geometry, Transform
orient_3 = Orient(Geometry=plane, Source=PlaneXY(0, 0, 0), Target=xy_plane)  # -> Geometry, Transform
planes = ClusterOutput(orient_3.Geometry)
geometry_2 = ClusterOutput(orient_2.Geometry)

# ==== cluster Plane_conversion
plane = ClusterInput()

# ---- group: Orient XY planes to Robot tool orientation
# README: This script has one or multiple XY planes as input. The XY planes are then rotated to simulate the coordinate system om RoboDK. This way, the robot tool never has to make a rotation of 180 degrees to get the object.
xy_plane = XYPlane(Origin=Point(0, 0, 0))
flip_plane = FlipPlane(Plane=plane, ReverseX=True, ReverseY=False, SwapAxes=False)
vector_2pt = Vector2Pt(PointA=xy_plane, PointB=flip_plane, Unitize=False)  # -> Vector, Length
deconstruct_plane = DeconstructPlane(Plane=flip_plane)  # -> Origin, XAxis, YAxis, ZAxis
angle = Angle(VectorA=deconstruct_plane.XAxis, VectorB=vector_2pt.Vector)  # -> Angle, Reflex
degrees = Degrees(Radians=angle.Angle)
larger_than = LargerThan(FirstNumber=degrees, SecondNumber=90)  # -> LargerThan, OrEqualTo
multiplication = Multiplication(A=larger_than.LargerThan, B=180)
rotate = Rotate(Geometry=flip_plane, Angle=degrees(multiplication), Plane=flip_plane)  # -> Geometry, Transform

# ----
geometry = ClusterOutput(rotate.Geometry)
